# Grasshopper definition ServerGHowl.gh (Grasshopper 0.9.76)
# plug-ins: Python Interpreter, gHowl

receiving_port = Panel("10131")
client_ip = Panel("10.0.0.2")
sending_port = Panel("10132")
# Network Informations
local_ip = Panel("10.0.0.4")

udp_receiver = UDPReceiver(Address=local_ip, Port=receiving_port, Pattern=0)  # -> Info, Data

# ---- group: Dispatcher
python_script = PythonScript(Message=udp_receiver.Data)  # -> Command, Test
# ---------- python_script: Python ----------
###############################################
# Author: Ayoub Lharchi 
# Contact: ayoublharchi@gmail.com
#
# ITECH Research Pavillion 2015/2016
# University of Stuttgart
#
# Last Edit: 02/07/2016
###############################################

# This component is to dispatch the incoming message from the client.
# With T_ prefix: it's a message to test connection
# With C_ prefix: Actual command to be parsed and executed

Test = False
Command = "None"
typeOfMessage = Message[0:2]

if typeOfMessage == "T_":
    Test = True
elif typeOfMessage == "C_":
    Command = Message[2:]
# ---------- end python_script ----------

# ---- group: To test the connection
python_script_2 = PythonScript(Test=python_script.Test, ClientIP=client_ip, SendingPort=sending_port)  # inputs Test: Boolean
# ---------- python_script_2: Python ----------
###############################################
# Author: Ayoub Lharchi 
# Contact: ayoublharchi@gmail.com
#
# ITECH Research Pavillion 2015/2016
# University of Stuttgart
#
# Last Edit: 02/07/2016
###############################################

import ghpythonlib.components as gh
if Test == True:
    gh.gHowl.UDPSender(ClientIP, SendingPort, 0, "The Robot A is connected")
# ---------- end python_script_2 ----------

# ----
command = Panel(python_script.Command)
